# Grasshopper definition 251002 b parametric setup.gh (Grasshopper 1.0.8)
# plug-ins: Karamba3D, MeshEdit Components, Pufferfish, Telepathy

panel = Panel("""25,-5,0
25,-10,0
25,-15,0""")
number_slider = Slider(2, range=0..100)
panel_2 = Panel("""0,-5,0
0,-10,0""")
pier_diameter_cross_section_cm = Slider(60, range=20..60)
shell_height_cross_section_cm = Slider(30, range=10..30)
expression = ValueList({"Parabola": 0, "Parabola Graph Mapper": 1, "Gaussian": 2, "Gaussian Graph Mapper": 3, "Linear Graph Mapper": 4}, selected="Gaussian")
curve_division_segments = Slider(5, range=0..20)
curve_selection = ValueList({"Curve1": 0, "Curve2": 1, "Curve3": 2, "Curve4": 3, "Curve5": 4}, selected="Curve4")

walking_path_width = Slider(3, range=2..4)
# keep as a fixed value
total_width = Slider(5, range=4..6)

number_of_piers = Slider(2, range=0..6)

c = Slider(0, range=-2..2)
A = Slider(-1.9, range=-3..3)
mu = Slider(0.4, range=0..1)
r = Slider(0.47, range=0.05..0.6)
sigma = Slider(0.32, range=0.05..1)
# 2
A_2 = Slider(1, range=0..5)
mu_2 = Slider(0.6, range=0..1)

pier_min_height = Slider(-2, range=-6..0)
colour = ColourPicker(PickedColour=RGB(97, 237, 230))
addition = Addition(A=number_of_piers, _1=1)
pier_diameter_cross_section_cm_2 = RemoteSender(pier_diameter_cross_section_cm)
shell_height_cross_section_cm_2 = RemoteSender(shell_height_cross_section_cm)

# ----
# Inputs
curve_division_segments_2 = RemoteSender(curve_division_segments)
walking_path_widht = RemoteSender(walking_path_width)
curve_number = RemoteSender(curve_selection)
total_width_2 = RemoteSender(total_width)

curve_division_segments_3 = RemoteReceiver(curve_division_segments_2)

number_of_piers_2 = RemoteSender(addition)
pier_min_height_2 = RemoteSender(pier_min_height)

parabola_b = RemoteSender(mu)
parabola_d = RemoteSender(c)
gaussian_b = RemoteSender(mu_2)
expression_2 = RemoteSender(expression)
parabola_a = RemoteSender(A)
gaussian_a = RemoteSender(A_2)
# 2
parabola_c = RemoteSender(r)
gaussian_c = RemoteSender(sigma)

# ----
# 6
# Hz
# Hz
# Hz
nmodes = RemoteSender(Slider(3, range=3..20))
# 3
# 4
# 5
panel_3 = Panel(walking_path_widht)
panel_4 = Panel("C40/50")
panel_5 = Panel("C60/75")
shell_height_cross_section_cm_3 = RemoteReceiver(shell_height_cross_section_cm_2)
matselect = MaterialSelectionKaramba3D(menu=[dropdown(0), dropdown(7), dropdown(4)])
matselect_2 = MaterialSelectionKaramba3D(NameOrListIndexOfMaterial="C30/37", menu=[dropdown(1), dropdown(0), dropdown(0)])
crosec = CrossSectionKaramba3D(
    FamilyNameOfCrossSection="DefaultCroSec",
    Material=matselect_2,
    Height_cm=shell_height_cross_section_cm_3,
    mode="Shell - Const")

# ----
# Self weight
panel_6 = Panel("L1")
loads = LoadsKaramba3D(Vector=Vector(0, 0, -1), LCase=panel_6, mode="Gravity")

nmodes_2 = RemoteReceiver(nmodes)

pt = Point("0,70,3")
tag = TextTag(Location=pt, Text="Analysis output")

curve_number_2 = RemoteReceiver(curve_number)
total_width_3 = RemoteReceiver(total_width_2)
curve3 = Curve(<curve referenced from the Rhino model>)
curve1 = Curve(<curve referenced from the Rhino model>)
curve2 = Curve(<curve referenced from the Rhino model>)
curve4 = Curve(<curve referenced from the Rhino model>)
curve5 = Curve(<curve referenced from the Rhino model>)
filter = StreamFilter(Gate=curve_number_2, Stream0=curve1, Stream1=curve2, Stream2=curve3, Stream3=curve4, Stream4=curve5)
neg = Negative(Value=total_width_3)
input_here_new_curve_to_test = Curve(<curve referenced from the Rhino model>)
X = UnitX(Factor=expr("x/2", [total_width_3, neg]))
path_curve = RemoteSender(filter)
path_curve_2 = RemoteReceiver(path_curve)
move = Move(Geometry=filter, Motion=X)  # -> Geometry, Transform
curve_division_segments_4 = RemoteReceiver(curve_division_segments_2)
curve_rails = RemoteSender(move.Geometry)
weave = Weave(Pattern=[0, 1], Stream0=move.Geometry, Stream1=path_curve_2, NullGaps=False)
divide = DivideCurve(Curve=weave, Count=curve_division_segments_4, Kinks=False)  # -> Points, Tangents, Parameters
tstat = TreeStatistics(Tree=divide.Points)  # -> Paths, Length, Count
item = ListItem(List=tstat.Paths, Index=0, Wrap=True)  # -> Item1, Item, Item1_2
merge = Merge(Data1=item.Item1, Data2=item.Item)
branch = TreeBranch(Tree=divide.Points, Path=merge, MaintainPaths=True)
lng = ListLength(List=branch)
list_lenght = RemoteSender(lng)
curve_rails_2 = RemoteReceiver(curve_rails)
range = Range(Domain=Domain(0, 1), Steps=expr("x-1", lng))
curve_rails_3 = RemoteReceiver(curve_rails)
eval = EvaluateCurve(Curve=reparameterize(curve_rails_2), Parameter=range)  # -> Point, Tangent, Angle
curve_division_segments_5 = RemoteReceiver(curve_division_segments_2)
crv_cp = CurveClosestPoint(Point=eval.Point, Curve=curve_rails_3)  # -> Point, Parameter, Distance
bnd = Bounds(Numbers=crv_cp.Point)
remap = RemapNumbers(Value=crv_cp.Point, Source=bnd, Target=Domain(0, 1))  # -> Mapped, Clipped
split = SplitTree(Data=divide.Points, Masks=flatten(merge))  # -> Positive, Negative
divide_2 = DivideCurve(Curve=curve_rails_3, Count=curve_division_segments_5, Kinks=False)  # -> Points, Tangents, Parameters
remaped_numbers = RemoteSender(remap.Mapped)
walking_path_widht_2 = RemoteReceiver(walking_path_widht)
total_width_4 = RemoteReceiver(total_width_2)
path_mapper = PathMapper(split.Negative, source="{A;B}", target="{0;1;0}")
expression_3 = Expression(x=total_width_4, w=walking_path_widht_2, Expression="Max(0.01,(1 - w / x) / 2)")
output_path_points = RemoteSender(path_mapper)
uv_point = RemoteSender(expression_3)
uv_point_2 = RemoteReceiver(uv_point)
subtraction = Subtraction(A=1, B=uv_point_2)
list = ValueList({"0", "1", "2", "3", "5"}, selected="5")
loft_opt = LoftOptions(Closed=Toggle(False), Adjust=Toggle(False), Rebuild=Slider(100, range=0..100), Refit=0, Type=list)
pt_2 = ConstructPoint(XCoordinate=[uv_point_2, subtraction], YCoordinate=0, ZCoordinate=0)
path_curve_3 = RemoteReceiver(path_curve)
panel_7 = Panel("""0.5,0
0.5,1""")
end = EndPoints(Curve=path_curve_3)  # -> Start, End
merge_2 = Merge(Data1=end.Start, Data2=end.End)
output_path_points_2 = RemoteReceiver(output_path_points)
pdecon = Deconstruct(Point=merge_2)  # -> XComponent, YComponent, ZComponent
sort = SortList(Keys=pdecon.YComponent, ValuesA=merge_2)  # -> Keys, ValuesA
item_2 = ListItem(List=sort.ValuesA, Index=0, Wrap=True)  # -> Item, Item1
vec2pt = Vector2Pt(PointA=item_2.Item, PointB=item_2.Item1, Unitize=False)  # -> Vector, Length

list_lenght_2 = RemoteReceiver(list_lenght)
range_2 = Range(Domain=Domain(0, 1), Steps=expr("x-1", list_lenght_2))
range_0_to_1 = RemoteSender(range_2)
range_0_to_1_2 = RemoteReceiver(range_0_to_1)
graph = GraphMapper(
    range_0_to_1_2,
    x0=0,
    x1=1,
    y0=0,
    y1=1,
    Ox=0.5479685664,
    Oy=0.0525714159,
    Px=1,
    Py=0.564370513,
    container_name="Parabola")
graph_2 = GraphMapper(
    range_0_to_1_2,
    x0=0,
    x1=1,
    y0=0,
    y1=1,
    container_name="Gaussian",
    factor=0.2419117689,
    mean=0.6146944761,
    sdev=0.1920779347)
graph_3 = GraphMapper(
    range_0_to_1_2,
    x0=0,
    x1=1,
    y0=0,
    y1=1,
    A=0.01062886611,
    B=-0.002219687393,
    container_name="Linear",
    Graph_x0=0.2088357657,
    Graph_x1=0.8013455868,
    Graph_y0=0,
    Graph_y1=0.006297707558)
remap_2 = RemapNumbers(Value=graph_3, Source=Domain(0, 1), Target="1 to 3")  # -> Mapped, Clipped
remap_3 = RemapNumbers(Value=graph, Source=Domain(0, 1), Target="1 to 3")  # -> Mapped, Clipped
remap_4 = RemapNumbers(Value=graph_2, Source=Domain(0, 1), Target="1 to 3")  # -> Mapped, Clipped
parabola_gm = RemoteSender(remap_3.Mapped)
gaussian_gm = RemoteSender(remap_4.Mapped)
linear_gm = RemoteSender(remap_2.Mapped)
path_curve_4 = RemoteReceiver(path_curve)
linear_gm_2 = RemoteReceiver(linear_gm)

remaped_numbers_2 = RemoteReceiver(remaped_numbers)
parabola_b_2 = RemoteReceiver(parabola_b)
parabola_d_2 = RemoteReceiver(parabola_d)
gaussian_a_2 = RemoteReceiver(gaussian_a)
gaussian_b_2 = RemoteReceiver(gaussian_b)
parabola_a_2 = RemoteReceiver(parabola_a)
parabola_c_2 = RemoteReceiver(parabola_c)
gaussian_c_2 = RemoteReceiver(gaussian_c)
expression_4 = Expression(
    t=remaped_numbers_2,
    A=gaussian_a_2,
    mu=gaussian_b_2,
    sigma=gaussian_c_2,
    Expression="A * Exp( - Pow((t - mu), 2) / (2 * Pow(sigma, 2)) )")
expression_5 = Expression(
    t=remaped_numbers_2,
    A=parabola_a_2,
    mu=parabola_b_2,
    r=parabola_c_2,
    c=parabola_d_2,
    Expression="c + A * Max(0, 1 - Pow((t - mu)/r, 2))")
parabola_expression = RemoteSender(expression_5)
gaussian_expression = RemoteSender(expression_4)
gaussian_gm_2 = RemoteReceiver(gaussian_gm)
parabola_gm_2 = RemoteReceiver(parabola_gm)
parabola_expression_2 = RemoteReceiver(parabola_expression)
gaussian_expression_2 = RemoteReceiver(gaussian_expression)
expression_6 = RemoteReceiver(expression_2)
filter_2 = StreamFilter(
    Expression=expression_6,
    Stream0=parabola_expression_2,
    Stream1=parabola_gm_2,
    Stream2=gaussian_expression_2,
    Stream3=gaussian_gm_2,
    Stream4=linear_gm_2)
z_values = RemoteSender(filter_2)

path_curve_5 = RemoteReceiver(path_curve)
cluster = Cluster(G=path_curve_5)  # -> G_2, panel, crv_2
tag_2 = TextTag(Location=cluster.G_2, Text=cluster.panel)
preview = CustomPreview(Geometry=cluster.crv_2, Material=colour)

# ----
# 1
path_curve_6 = Curve(path_curve_4)

z_values_2 = RemoteReceiver(z_values)
Z = UnitZ(Factor=z_values_2)
move_2 = Move(Geometry=divide_2.Points, Motion=Z)  # -> Geometry, Transform
output_railings_points = RemoteSender(move_2.Geometry)
merge_3 = Merge(Data1=output_path_points, Data2=output_railings_points)  # -> simplify(Result)
intcrv = Interpolate(Vertices=merge_3, Degree=3, Periodic=False, KnotStyle=1)  # -> Curve, Length, Domain
flatten = FlattenTree(Tree=intcrv.Curve, Path="{0}")

# ----
# Mesh supports
number_slider_2 = Slider(0.2, range=0..1)

# ----
# Piers cross section / material
pier_diameter_cross_section_cm_3 = RemoteReceiver(pier_diameter_cross_section_cm_2)
crosec_2 = CrossSectionKaramba3D(
    FamilyNameOfCrossSection="DefaultCroSec",
    Material=matselect_2,
    Diameter_cm=pier_diameter_cross_section_cm_3,
    WallThickness_cm=expr("x/2", pier_diameter_cross_section_cm_3),
    mode="Circular Hollow")

# ----
# External loads
load = Slider(-15, range=-15..6)
Z_2 = UnitZ(Factor=load)
neg_2 = Negative(Value=Z_2)

pier_min_height_3 = RemoteReceiver(pier_min_height_2)
number_of_piers_3 = RemoteReceiver(number_of_piers_2)
pt_3 = ConstructPoint(XCoordinate=0, YCoordinate=0, ZCoordinate=pier_min_height_3)
xy = XYPlane(Origin=pt_3)
panel_8 = Panel("""0
-1""")
pier_diameter_cross_section_cm_4 = RemoteReceiver(pier_diameter_cross_section_cm_2)
division = Division(A=pier_diameter_cross_section_cm_4, B="100")

crv = Curve(flatten)
loft = Loft(Curves=crv, Options=loft_opt)

srf = Surface(loft)
iso = IsoCurve(Surface=reparameterize(loft), UVPoint=pt_2)  # -> UIsocurve, VIsocurve
crv_2 = Curve(iso.VIsocurve)
srfsplit = SurfaceSplit(Surface=srf, Curves=flatten(crv_2))
loft_2 = Loft(Curves=flatten(crv_2), Options=loft_opt)
item_3 = ListItem(List=srfsplit, Index=0, Wrap=True)  # -> Item, Item1
flat_path_srf = RemoteSender(loft_2)
flat_path_srf_2 = RemoteReceiver(flat_path_srf)
merge_4 = Merge(Data1=item_3.Item, Data2=item_3.Item1, Data3=flat_path_srf_2)  # -> flatten(Result)
join = BrepJoin(Breps=merge_4)  # -> Breps, Closed
flat_path_srf_3 = RemoteReceiver(flat_path_srf)
evalsrf = EvaluateSurface(Surface=reparameterize(flat_path_srf_3), Point=panel_7)  # -> Point, Normal, UDirection, VDirection, Frame
pdecon_2 = Deconstruct(Point=evalsrf.Point)  # -> XComponent, YComponent, ZComponent
sort_2 = SortList(Keys=pdecon_2.YComponent, ValuesA=evalsrf.Point)  # -> Keys, ValuesA
item_4 = ListItem(List=sort_2.ValuesA, Index=0, Wrap=True)  # -> Item, Item1
vec2pt_2 = Vector2Pt(PointA=item_4.Item, PointB=item_4.Item1, Unitize=False)  # -> Vector, Length
orient = OrientDirection(Geometry=crv_2, PointA=item_4.Item, DirectionA=vec2pt_2.Vector, PointB=item_2.Item, DirectionB=vec2pt.Vector)  # -> Geometry, Transform
end_2 = EndPoints(Curve=orient.Geometry)  # -> flatten(Start), flatten(End)
item_5 = ListItem(List=end_2.End, Index=0, Wrap=True)  # -> Item, Item1
item_6 = ListItem(List=end_2.Start, Index=0, Wrap=True)  # -> Item, Item1
dist = Distance(PointA=item_6.Item, PointB=item_6.Item1)
ln = Line(StartPoint=item_5.Item, EndPoint=item_5.Item1)
ln_2 = Line(StartPoint=item_6.Item, EndPoint=item_6.Item1)
supporta = RemoteSender(ln)
supportb = RemoteSender(ln_2)
path_width = RemoteSender(dist)
flat_path_srf_4 = RemoteReceiver(flat_path_srf)
orient_2 = OrientDirection(Geometry=flat_path_srf_4, PointA=item_4.Item, DirectionA=vec2pt_2.Vector, PointB=item_2.Item, DirectionB=vec2pt.Vector)  # -> Geometry, Transform
flat_path_srf_oriented = RemoteSender(orient_2.Geometry)
flat_path_srf_oriented_2 = RemoteReceiver(flat_path_srf_oriented)
pull = PullPoint(Point=output_path_points_2, Geometry=flat_path_srf_oriented_2, ClosestOnly=True)  # -> ClosestPoint, Distance, Index
output_flat_points = RemoteSender(pull.ClosestPoint)

output_flat_points_2 = RemoteReceiver(output_flat_points)
output_flat_points_3 = Point(flatten(output_flat_points_2))

total_width_5 = RemoteReceiver(total_width_2)
uv_point_3 = RemoteReceiver(uv_point)
panel_9 = Panel(uv_point_3)
expression_7 = Expression(x=total_width_5, uv=uv_point_3, Expression="x*(1-2*uv)")
path_width_2 = RemoteReceiver(path_width)
panel_10 = Panel(path_width_2)
panel_11 = Panel(expression_7)

# ----
# Outputs
path_points = Point(output_flat_points_2)

intcrv_2 = Interpolate(Vertices=path_points, Degree=3, Periodic=False, KnotStyle=1)  # -> Curve, Length, Domain

supporta_2 = RemoteReceiver(supporta)
supportb_2 = RemoteReceiver(supportb)

output_flat_points_4 = RemoteReceiver(output_flat_points)
intcrv_3 = Interpolate(Vertices=output_flat_points_4, Degree=3, Periodic=False, KnotStyle=1)  # -> Curve, Length, Domain
divide_3 = DivideCurve(Curve=intcrv_3.Curve, Count=number_of_piers_3, Kinks=False)  # -> Points, Tangents, Parameters
cull_i = CullIndex(List=divide_3.Points, Indices=panel_8, Wrap=True)
pull_2 = PullPoint(Point=cull_i, Geometry=xy, ClosestOnly=True)  # -> ClosestPoint, Distance, Index
pier_support_closest_points = RemoteSender(pull_2.ClosestPoint)
ln_3 = Line(StartPoint=cull_i, EndPoint=pier_support_closest_points)
flat_path_srf_oriented_3 = RemoteReceiver(flat_path_srf_oriented)

pier_support_closest_points_2 = RemoteReceiver(pier_support_closest_points)
pt_4 = Point(flatten(pier_support_closest_points_2))

# ----
# Piers supports
pier_support_closest_points_3 = RemoteReceiver(pier_support_closest_points)
supp = SupportKaramba3D(
    PosInd=pier_support_closest_points_3,
    Ct_kN_m=Vector(0, 0, 0),
    Cr_kNm_rad=Vector(0, 0, 0),
    menu=[buttons(on, on, on, on, on, on)])

end_3 = EndPoints(Curve=ln_3)  # -> Start, End
output_brep_to_orient = RemoteSender(join.Breps)

pier_end_point = RemoteSender(end_3.End)
pier_start_point = RemoteSender(end_3.Start)
srf_cp = SurfaceClosestPoint(Point=end_3.Start, Surface=flat_path_srf_oriented_3)  # -> Point, UVPoint, Distance
cir = Circle(Plane=end_3.End, Radius=expr("x/2", division))
evalsrf_2 = EvaluateSurface(Surface=flat_path_srf_oriented_3, Point=srf_cp.UVPoint)  # -> Point, Normal, UDirection, VDirection, Frame
xy_2 = XYPlane(Origin=end_3.End)
point_support = RemoteSender(evalsrf_2.Point)
orient_3 = Orient(Geometry=cir, Source=xy_2, Target=evalsrf_2.Frame)  # -> Geometry, Transform
merge_5 = Merge(Data1=simplify(graft(orient_3.Geometry)), Data2=simplify(graft(cir)))
loft_3 = Loft(Curves=merge_5, Options={Adjust=True, Closed=False, LoftEnds=0, LoftSimp=0, LoftType=0, Rebuild=10, Refit=0.01})

pier_start_point_2 = RemoteReceiver(pier_start_point)
pier_end_point_2 = RemoteReceiver(pier_end_point)
pier_start_point_3 = Point(flatten(pier_end_point_2))
pier_end_point_3 = Point(flatten(pier_end_point_2))
point_support_2 = RemoteReceiver(flatten(point_support))
ln_4 = Line(StartPoint=point_support_2, EndPoint=pt_4)
piers_line = RemoteSender(ln_4)

piers_line_2 = RemoteReceiver(piers_line)
lineelem = CreateLinearElementKaramba3D(
    Line=piers_line_2,
    CrossSection=crosec_2,
    LimitDistance_m=0.005,
    BucklingLengthY_m=-1,
    BucklingLengthZ_m=-1,
    BucklingLengthLT_m=-1,
    Bending=True,
    ToPolylineMaxAngle=0.25,
    ToPolylineTolerance=0.1,
    ToPolylineMaxEdgeLength=0.25,
    New=True,
    Remove=True,
    mode="LineToBeam")  # -> Element, Points, Info

output_brep_to_orient_2 = RemoteReceiver(output_brep_to_orient)
orient_4 = OrientDirection(
    Geometry=output_brep_to_orient_2,
    PointA=item_4.Item,
    DirectionA=vec2pt_2.Vector,
    PointB=item_2.Item,
    DirectionB=vec2pt.Vector)  # -> Geometry, Transform

piers_brep = RemoteSender(loft_3)
output_brep = RemoteSender(orient_4.Geometry)

output_brep_2 = RemoteReceiver(output_brep)
debrep = DeconstructBrep(Brep=output_brep_2)  # -> Faces, Edges, Vertices
len = Length(Curve=debrep.Edges)
sort_3 = SortList(Keys=len, ValuesA=debrep.Edges)  # -> Keys, reverse(ValuesA)
item_7 = ListItem(List=sort_3.ValuesA, Index=0, Wrap=True)  # -> Item, Item1
divide_4 = DivideCurve(Curve=[item_7.Item, item_7.Item1], Count=curve_division_segments_3, Kinks=False)  # -> Points, Tangents, Parameters
output_brep_3 = RemoteReceiver(output_brep)
piers_brep_2 = RemoteReceiver(piers_brep)

cluster_2 = Cluster_2(output_brep=output_brep_3, output_piers=piers_brep_2)  # -> G, brep_2, panel
tag_3 = TextTag(Location=cluster_2.G, Text=cluster_2.panel)

output_brep_4 = RemoteReceiver(output_brep)
mesh_breps = MeshBrepsKaramba3D(
    Brep=output_brep_4,
    InclusionPoints=point_support_2,
    MeshResolution=Slider(1, range=0..10),
    EdgeRefinementFactor=0.67,
    PointReduction=False,
    SmoothingStepSize=0,
    SmoothingIterations=5)  # -> Mesh, Info
flip = MeshFlip(Mesh=mesh_breps.Mesh)
mjoin = MeshJoin(Meshes=flip)
surfelem = CreateSurfaceElementKaramba3D(Mesh=mjoin, CrossSection=crosec, LimitDistance_m=0.005, Bending=True, mode="MeshToShell")  # -> Element, Points, Info

crv_cp_2 = CurveClosestPoint(Point=surfelem.Points, Curve=supporta_2)  # -> Point, Parameter, Distance
crv_cp_3 = CurveClosestPoint(Point=surfelem.Points, Curve=supportb_2)  # -> Point, Parameter, Distance
smaller = SmallerThan(FirstNumber=crv_cp_2.Distance, SecondNumber=number_slider_2)  # -> SmallerThan, OrEqualTo
smaller_2 = SmallerThan(FirstNumber=crv_cp_3.Distance, SecondNumber=number_slider_2)  # -> SmallerThan, OrEqualTo
cull = CullPattern(List=surfelem.Points, CullPattern=smaller.SmallerThan)
cull_2 = CullPattern(List=surfelem.Points, CullPattern=smaller_2.SmallerThan)
supp_2 = SupportKaramba3D(PosInd=cull_2, Ct_kN_m=Vector(0, 0, 0), Cr_kNm_rad=Vector(0, 0, 0), menu=[buttons(on, on, on, off, off, off)])
supp_3 = SupportKaramba3D(PosInd=cull, Ct_kN_m=Vector(0, 0, 0), Cr_kNm_rad=Vector(0, 0, 0), menu=[buttons(off, on, on, off, off, off)])

mesh = Mesh(mjoin)
loads_2 = LoadsKaramba3D(Vector=Z_2, Mesh=mesh, LCase="L2", mode="MeshLoad -Const.", menu=[buttons(off, on, off), buttons(on, off)])

merge_6 = Merge(Data1=flatten(supp_2), Data2=flatten(supp_3), Data3=flatten(supp))
merge_7 = Merge(Data1=flatten(loads), Data2=flatten(loads_2))
merge_8 = Merge(Data1=flatten(surfelem.Element), Data2=flatten(lineelem.Element))
assemble = AssembleModelKaramba3D(Elem=merge_8, Support=merge_6, Load=merge_7, LimitDistance_m=0.005)  # -> Model, Info, Mass_kg, CentreOfGravity, LoadCaseNames
round = Round(Number=assemble.Mass_kg)  # -> Nearest, Floor, Ceiling
mass_kg = RemoteSender(round.Nearest)
mass_kg_2 = RemoteReceiver(mass_kg)
roundd = RoundToDecimalPlace(NumberX=mass_kg_2, DecimalPlace=1, RoundType=0)  # -> Rounded, Difference
concat = Concatenate(FragmentA=roundd.Rounded, FragmentB=" Kg")
tag_4 = TextTag3D(Location="0,-15,0", Text=concat, Size=number_slider, Justification=7)
nvibes = NaturalVibrationsKaramba3D(
    Model=assemble.Model,
    FromIndex=1,
    NumberOfModes=nmodes_2,
    WithThIIEffects=False,
    MaximumNumberOfIterations=30,
    Epsilon=1e-05)  # -> ModelWithVibrationModes, NaturalFrequencies_Hz, ModalMass_kg, ParticipationFactorInGlobalXYAndZDirection
analyse = AnalyseKaramba3D(Model=assemble.Model)  # -> AnalysedModel, MaximumDisplacement_cm, ResultingForce_kN, ChangeOfElasticEnergy_kNm
max_displacement_cm = RemoteSender(analyse.MaximumDisplacement_cm)
max_displacement_cm_2 = RemoteReceiver(max_displacement_cm)
roundd_2 = RoundToDecimalPlace(NumberX=max_displacement_cm_2, DecimalPlace=1, RoundType=0)  # -> Rounded, Difference
concat_2 = Concatenate(FragmentA=roundd_2.Rounded, FragmentB=" cm")
tag_5 = TextTag3D(Location=panel_2, Text=concat_2, Size=number_slider, Justification=7)

path_points_2 = Point(graft(pier_end_point_2))
path_points_3 = Point(graft(pier_start_point_2))
path_points_4 = Point(divide_4.Points)
panel_12 = Panel(roundd.Rounded)
panel_13 = Panel(roundd_2.Rounded)

# ----
# Kg
intcrv_4 = Interpolate(Vertices=path_points_4, Degree=3, Periodic=False, KnotStyle=1)  # -> Curve, Length, Domain
intcrv_5 = Interpolate(Vertices=[path_points_2, path_points_3], Degree=3, Periodic=False, KnotStyle=1)  # -> Curve, Length, Domain
# cm
# cm
item_8 = ListItem(List=roundd_2.Rounded, Index=0, Wrap=True)
multiplication = Multiplication(A=item_8, B="1.5")
multiplication_2 = Multiplication(A=item_8, B="1.35")
addition_2 = Addition(A=multiplication_2, B=multiplication)
panel_14 = Panel(addition_2)
nfrequ = RemoteSender(nvibes.NaturalFrequencies_Hz)
nfrequ_2 = RemoteReceiver(nfrequ)
roundd_3 = RoundToDecimalPlace(NumberX=nfrequ_2, DecimalPlace=1, RoundType=0)  # -> Rounded, Difference
concat_3 = Concatenate(FragmentA=roundd_3.Rounded, FragmentB=" Hz")
tag_6 = TextTag3D(Location=panel, Text=concat_3, Size=number_slider, Justification=7)
panel_15 = Panel(nfrequ_2)
modelview = ModelViewKaramba3D(Model=analyse.AnalysedModel)  # -> Model, DeformedMesh, DeformedAxes, DeformedModel, MaximumDeformation

preview_2 = CustomPreview(Geometry=cluster_2.brep_2, Material=colour)
shellview = ShellViewKaramba3D(Model=modelview.Model, IndexOfLayer=0)  # -> Model, MeshesOfRenderedShells, LegendColours, LegendTags
beamview = BeamViewKaramba3D(Model=modelview.Model)  # -> Model, MeshesOfRenderedBeams, DeformedBeamAxes, LegendColours, LegendTags

utilization = UtilizationOfElementsKaramba3D(AnalysedModel=modelview.Model, mode="Shells")  # -> Model, Utilization, LoadCaseIndex
shift = ShiftList(List=shellview.LegendTags, Shift=1, Wrap=invert(True))
legend = LegendKaramba3d(
    Colors=shellview.LegendColours,
    Tags=shellview.LegendTags,
    Scale=0.8,
    Textsize=30,
    Viewport="Perspective",
    Legend_HasHeader=False,
    Legend_Justification=2,
    Legend_Position=2)
cull_i_2 = CullIndex(List=shift, Indices="-1", Wrap=True)
avr = Average(Input=flatten(utilization.Utilization))
bnd_2 = Bounds(Numbers=flatten(utilization.Utilization))
panel_16 = Panel(cull_i_2)
panel_17 = Panel(bnd_2)
panel_18 = Panel(avr)

# ==== cluster Cluster
G = ClusterInput()
move = Move(Geometry=G, Motion="30,0,0")  # -> Geometry, Transform
crv = Curve(move.Geometry)
crv_2 = ClusterOutput(crv)
midpt = CurveMiddle(Curve=crv)
move_2 = Move(Geometry=midpt, Motion="0,60,3")  # -> Geometry, Transform
panel = ClusterOutput("Curve input")
G_2 = ClusterOutput(move_2.Geometry)

# ==== cluster Cluster_2
output_piers = ClusterInput()
output_brep = ClusterInput()
move = Move(OutputPIERS=output_piers, Motion="10,0,0")  # -> Geometry, Transform
move_2 = Move(OutputBREP=output_brep, Motion="10,0,0")  # -> Geometry, Transform
merge = Merge(Data1=move_2.Geometry, Data2=move.Geometry)
area = Area(Geometry=move_2.Geometry)  # -> Area, Centroid
brep = Brep(merge)
brep_2 = ClusterOutput(brep)
move_3 = Move(Geometry=area.Centroid, Motion="0,60,4")  # -> Geometry, Transform
G = ClusterOutput(move_3.Geometry)
panel = ClusterOutput("Geometry input")
